# Grasshopper definition Brep_Plane_Intersection_01.gh (Grasshopper 1.0.5)

# ---- group: Generate Floor Heights
series = Series(Start=0, Step="4", Count="50")

# ---- group: Building Massing (BREP)
brep = Brep(<brep referenced from the Rhino model>)

# ----
floor_heights = Panel(series)
c_script = CSharpScript(rep=brep, heights=series)  # -> out, A; inputs rep: Brep, heights: list of Double
# ---------- c_script: C# ----------
    // this will hold the final list of curves
    List<Curve> outCrvs = new List<Curve>();

    // generate default Z vector
    Vector3d upVect = new Vector3d(0, 0, 1);
    
    foreach(double height in heights){
      
      // generate point at appropiate Z hight
      Point3d pt = new Point3d(0, 0, height);
      
      // generate horizontal plane at apporpiate hight
      Plane pln = new Plane(pt, upVect);
      
      // create empty arrays to hold returned geometry
      Curve[] Crvs;
      Point3d[] Pts;

      if(Rhino.Geometry.Intersect.Intersection.BrepPlane(rep, pln, RhinoDocument.ModelAbsoluteTolerance, out Crvs, out Pts))
      {
        outCrvs.Add(Crvs[0]);   // save the first curve in the array
      }
    }

    A = outCrvs;
# ---------- end c_script ----------

# ---- group: Output Curves
curve = Curve(c_script.A)
panel = Panel(curve)

# ----
area = Area(Geometry=curve)  # -> Area, Centroid
panel_2 = Panel(area.Area)
